# Grasshopper definition toy_problem.gh (Grasshopper 1.0.7)

panel = Panel("start configuration")
panel_2 = Panel("collision")
panel_3 = Panel("ideal path")
python = GhPythonScript()  # -> out, start_configuration
# ---------- python: Python ----------
from compas_fab.robots import Configuration

start_configuration = Configuration((-0.820, -1.874, 0.111, 0.779, 1.125, -0.084, 4.122, 1.800, -1.570, 0.000, 0.000, 0.000, 0.000, 0.000), (2, 0, 0, 0, 0, 0, 0, 2, 0, 0, 0, 0, 0, 0), ('cartA_joint', 'robotA_joint_1', 'robotA_joint_2', 'robotA_joint_3', 'robotA_joint_4', 'robotA_joint_5', 'robotA_joint_6', 'cartB_joint', 'robotB_joint_1', 'robotB_joint_2', 'robotB_joint_3', 'robotB_joint_4', 'robotB_joint_5', 'robotB_joint_6'))
# ---------- end python ----------
brep = Brep(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)
crv = Curve(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)
python_2 = GhPythonScript(curve=crv, N=Slider(20, range=0..100))  # -> out, tool_planes; inputs curve: Curve
# ---------- python_2: Python ----------
__author__ = "rustr"
__version__ = "2020.09.22"

import rhinoscriptsyntax as rs
import Rhino.Geometry as rg

tool_planes = []

for t in curve.DivideByCount(N - 1, True):
    ok, plane = curve.FrameAt(t)
    tool_planes.append(rg.Plane(plane.Origin, plane.ZAxis, plane.YAxis))
    print tool_planes[-1].ZAxis
# ---------- end python_2 ----------
button = Button()
mesh = Mesh(brep)
python_3 = GhPythonScript(mesh=mesh, save=button)  # -> out, path, filename; inputs mesh: Mesh
# ---------- python_3: Python ----------
import os
from compas_rhino.geometry import RhinoMesh

M = RhinoMesh.from_geometry(mesh)
mesh = M.to_compas()

path = os.path.join(os.path.expanduser("~"), "Desktop")
filename = os.path.join(path, "mesh.json")


if save:
    mesh.to_json(filename)
# ---------- end python_3 ----------
python_4 = GhPythonScript(planes=python_2.tool_planes, path=python_3.path, save=button)  # -> out, filename; inputs planes: list of Plane
# ---------- python_4: Python ----------
import os
import json
from compas.geometry import Frame

frames = [Frame(p.Origin, p.XAxis, p.YAxis) for p in planes]

filename = os.path.join(path, "frames.json")

if save:
    with open(filename, 'w') as f:
        json.dump([frame.data for frame in frames], f)
# ---------- end python_4 ----------
panel_4 = Panel(python_3.filename)
panel_5 = Panel(python_4.filename)
