# Grasshopper definition export_meshes_to_objs.gh (Grasshopper 1.0.7)
# plug-ins: LunchBox

# ---- group: thin panel
mesh = Mesh(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)

# ---- group: TC
mesh_2 = Mesh([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])

# ---- group: g2
mesh_3 = Mesh()

# ----
mesh_4 = Mesh([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])
panel = Panel("C:\Users\harry\Dropbox (MIT)\code_ws_dropbox\itj_ws\integral_timber_joints\external\compas_fab_pychoreo\tests\data")

# ---- group: link2
link2_extraacm = Mesh(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)

# ---- group: link3
link3_extraacm = Mesh(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)

# ---- group: long tube
mesh_5 = Mesh([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])

# ---- group: g1
mesh_6 = Mesh([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])

# ---- group: tubes
mesh_7 = Mesh([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])

# ----
merge = Merge(Data1=link2_extraacm, Data2=link3_extraacm)
panel_2 = Panel("D:\code_ws\pb_ws\compas_fab_pychoreo\tests\data\itj_rfl_obstacles")
panel_3 = Panel("TC_static")
mesh_8 = Mesh(simplify(graft(mesh)))
tree_statistics = TreeStatistics(Tree=mesh_8)  # -> Paths, Length, Count
list_item = ListItem(List=tree_statistics.Paths, Index=Slider(53, range=0..53), Wrap=True)
tree_branch = TreeBranch(Tree=mesh_8, Path=list_item, MaintainPaths=True)

# ---- group: link2
link2_extraacm_2 = Mesh(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)

# ---- group: link3
link3_extraacm_2 = Mesh(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)

# ----
concatenate = Concatenate(Fragment_A=panel, A="\", Fragment_B="thin_panel")
button = Button()
deconstruct_path = DeconstructPath(Branch=tree_statistics.Paths)  # -> simplify(Indices)
concatenate_2 = Concatenate(Fragment_A="thin_panel", B="_", A=deconstruct_path, Fragment_B=".obj")
mkdir = Mkdir(fp=concatenate)  # -> out, fp
# ---------- mkdir: Python ----------
import os

if not os.path.exists(fp):
    os.mkdir(fp)
    print('Dir made: {}'.format(fp))
else:
    print('Dir exists!')
a = fp
# ---------- end mkdir ----------
object_save = ObjectSave(
    BakeToggle=Toggle(False),
    FileDirectory=mkdir.fp,
    FileName=concatenate_2,
    GeometryObjects=mesh_8,
    Layer="GH_Export",
    ObjectName="GH_Obj",
    ObjectColor=RGB(255, 255, 255),
    LayerColor=RGB(255, 255, 255))
panel_4 = Panel(concatenate_2)
